# Dynamo graph 01-Few-Shot.dyn (Dynamo 2.19.3.6394)

sequence = Sequence()
python_script = Python(IN[0]=sequence)  # CPython3
# ---------- python_script.python (14 lines) ----------
# Input: IN[0] (List of numbers)
a = IN[0]

# Initialize the output list
b = []

# Calculate the running total
running_total = 0
for num in a:
    running_total += num
    b.append(running_total)

# Output: OUT (List of running totals)
OUT = b
# ----------------------------------------
watch = Watch(python_script)
watch_2 = Watch(sequence)
