# Grasshopper definition Extrude-curve-offset.gh (Grasshopper 1.0.8)
# plug-ins: RhinoCodePluginGH

doubleclick = BooleanToggle(False)
dss_annotation_panel = Panel("Help on WhiteWork")
# Segment
# group modules into larger coherent parts
# User Interface: I/O
dss_log_v5_2 = PythonScript(Help=doubleclick)  # inputs Help: Boolean
# ---------- dss_log_v5_2: Python ----------
"""
Set grasshopper template and provide easy acces to Help file in intranet

"""

"""
Credits:
    20211117
    Created by Vladimir Ondejcik
    White arkitekter AB

Based on:
    WOMBAT version <0.0.1>
    Script by <Brian Ringley>
        def libraries() by <Giulio Piacentino> see <http://www.grasshopper3d.com/forum/topics/gh-filename-is-python>
        def writeToFile() by <Data Analytics Society> see <https://www.youtube.com/watch?v=-TF3mXhnCDw>
    Script version <15 September 2015> 
    Copyright <Creative Commons Sharealike>
"""


#add dsearch default path located on cad.local
import sys
new_path = r"\\sesthfs02\DSEARCH\REPOSITORY\Grasshopper\Xtras\DsearchCode"
if new_path not in sys.path: sys.path.append(new_path)

#import dsearch plugin
import dsearch as ds

import os

print sys.path

#reload module (this has use when working on module)
#reload(ds.DS_Log)
#reload(ds.DS_Links)

#setup template
template=ds.DS_Links.Template
ds.DS_Log.DS_Template(template)

#run help from module 
if Help:
    helpLink=ds.DS_Links.HelpLink
    ds.DS_Log.DS_Help(helpLink)

    #turn toggle back to false
    obj=ghenv.Component.Params.Input[0].Sources[0]
    obj.Value=False
    obj.ExpireSolution(True)
# ---------- end dss_log_v5_2 ----------

dss_projectnumber = Panel("0000")
dss_projectname = Panel("name")

# ----
# Organization of Grasshopper scripts at White:
# Script should be created and annotated always with notion that other person will need to use/edit them.
# Build your script in modules and segments, use color coding and annotation according this template.
# This standard should be applied to all scripts, big or small.
# 
# Read  guide on white work:
# "https://work.white.se/grasshopper-developer-guide/"
# For Advanced users:
# For design scripts running more than a month use "dsInitialize" and "dsScriptLog" functions on Dsearch tab to log changes over time.
dss_annotation_panel_2 = Panel("""Tip of a day:
You can change default colour grups by right clicking
Graphical templates are located on "Dsearch" tab""")
# GRAPHIC
# STANDARD
# In
# data and geometry import from rhino or external platforms
image = ImageSampler(dss_annotation_panel_2, Filter="Colour", Interpolate=False, Umax=1, Umin=0, Vmax=1, Vmin=0, Wrap=0)

file_path = FilePath("W:\Internal projects\ScriptingForAll1099922700\2. Work\03. Workshop Materials\GitHub_CoPilot\03-Explain_Scripts\extrude_curve.py")
curve = Curve(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)
python_3_script = Python3Script(
    script=file_path,
    curve=curve,
    height=Slider(100, range=0..100),
    scale_factor=Slider(1.01, range=0..4),
    offset_distance=Slider(41, range=0..41))  # -> out, polysurface; inputs curve: Curve, height: Double, scale_factor: Double, offset_distance: Double
#   port script: Script to execute
# ---------- python_3_script: Python ----------
import rhinoscriptsyntax as rs

# Extrude the curve
start_point = rs.CurveStartPoint(curve)
end_point = rs.PointAdd(start_point, (0, 0, height))
extrusion = rs.ExtrudeCurveStraight(curve, start_point, end_point)
    
 # Scale the extrusion
centroid = rs.SurfaceAreaCentroid(extrusion)[0]
scaled_extrusion = rs.ScaleObject(extrusion, centroid, (scale_factor, scale_factor, scale_factor))

# offset the scaled extrusion
offset_extrusion = rs.OffsetSurface(scaled_extrusion, offset_distance, create_solid=True)
    
 # Convert to polysurface
polysurface = rs.coercebrep(offset_extrusion)
# ---------- end python_3_script ----------

# ----
# Control
# General
# Monitor
# Out
# variable parameters and script execution
# (sliders, boolean togggle, text input,...)
# monitor data and geometry preview (used for panels for example)
# output data to rhino or external platforms
# WIP
# Annotation
# Plugin
# general annotation and notes
# textbased scripting and special plugins
# f.ex: HumanUI, kangaroo,...
# problematic or under repair or construction
# Back-end
dss_annotation_panel_3 = Panel("general development modules")
